# Dynamo graph DesignScript.dyn (Dynamo 2.10.1.3976)

# group: Design Script
boolean = BoolSelector(false)
python_script = Python(IN[0]=boolean)  # IronPython2
# ---------- python_script.python (3 lines) ----------
f = open(r"U:\17_TraningAdvanceDynamo\2_WORKING\Tool\Dynamo\Traning-Dynamo-2024\DesignScript.py", "r")
f = open(r"A:\Library-Dynamo-Python-CSharp\test.py", "r")
OUT = f.read() 
# ----------------------------------------
python_script_from_string = PythonStringNode(script=python_script)  # IronPython2; unwired: IN[0], IN[1]

python_script_2 = Python()  # IronPython2; unwired: IN[0]
# ---------- python_script_2.python (94 lines) ----------
import clr
clr.AddReference("System")
import System
clr.AddReference('RevitAPI')
from Autodesk.Revit.DB import *
from Autodesk.Revit.DB import Transaction, FilteredElementCollector
from System.Collections.Generic import List
import json

clr.AddReference('RevitAPIUI')
from Autodesk.Revit.UI import *
from Autodesk.Revit.UI.Selection import *

clr.AddReference("RevitServices")
import RevitServices
from RevitServices.Persistence import DocumentManager
from RevitServices.Transactions import TransactionManager
#########################################################################

import wpf
from System.Windows import Application, Window
from System.Windows.Controls import ListBoxItem, CheckBox, TextBox, RadioButton, Button, StackPanel, TextBlock
from System.Windows.Media import Brushes

#########################################################################
doc = DocumentManager.Instance.CurrentDBDocument
view = doc.ActiveView
uidoc = DocumentManager.Instance.CurrentUIApplication.ActiveUIDocument
#########################################################################

class ViewModel:
    def __init__(self):
        pass

class MyWindow(Window):
    def __init__(self, viewModel):
        self.ui = wpf.LoadComponent(self, "U:\\17_TraningAdvanceDynamo\\2_WORKING\\Tool\\Design\\ConfigSelections\\config_view.xaml")
        self.InitializeComponents()

    def InitializeComponents(self):
        self.searchBox = self.FindName("searchBox")
        self.listBox = self.FindName("listBox")
        self.jsonOutput = self.FindName("jsonOutput")
        self.rbtnCheckAll = self.FindName("rbtnCheckAll")
        self.rbtnCheckNone = self.FindName("rbtnCheckNone")
        self.btnOK = self.FindName("btnOK")
        self.btnCancel = self.FindName("btnCancel")

    def SearchBox_TextChanged(self, sender, e):
        searchText = self.searchBox.Text.lower()
        for item in self.listBox.Items:
            if isinstance(item, ListBoxItem) and isinstance(item.Content, CheckBox):
                checkBox = item.Content
                item.Visibility = System.Windows.Visibility.Visible if searchText in checkBox.Content.lower() else System.Windows.Visibility.Collapsed

    def rbtnCheckAll_Checked(self, sender, e):
        self.SetAllCheckBoxes(True)

    def rbtnCheckNone_Checked(self, sender, e):
        self.SetAllCheckBoxes(False)

    def SetAllCheckBoxes(self, isChecked):
        for item in self.listBox.Items:
            if isinstance(item, ListBoxItem) and isinstance(item.Content, CheckBox):
                checkBox = item.Content
                checkBox.IsChecked = isChecked
        self.UpdateJsonOutput()

    def CheckBox_Click(self, sender, e):
        self.UpdateJsonOutput()

    def UpdateJsonOutput(self):
        selected_items = []
        for item in self.listBox.Items:
            if isinstance(item, ListBoxItem) and isinstance(item.Content, CheckBox):
                checkBox = item.Content
                if checkBox.IsChecked:
                    selected_items.append({"name": checkBox.Content})
        json_output = json.dumps(selected_items, indent=4)
        self.jsonOutput.Text = json_output

    def btnOK_Click(self, sender, e):
        System.Windows.MessageBox.Show("OK button clicked")
        self.DialogResult = True
        self.Close()

    def btnCancel_Click(self, sender, e):
        System.Windows.MessageBox.Show("Cancel button clicked")
        self.DialogResult = False
        self.Close()

viewModel = ViewModel()
window = MyWindow(viewModel)
showDialog = window.ShowDialog()
# ----------------------------------------
